# Grasshopper definition GH_code.gh (Grasshopper 1.0.8)

neg = Negative(Value=Slider(239.61, range=0..1000))
path = FilePath("C:\Users\shiyi\OneDrive\Documents\0-Academic acativities\DF2026\Preparation\04_Model_Packaging_Demo\DF_2026_Demo\rf_model.onnx")
c_script = CSharpScript(
    ModelPath=path,
    X1=Slider(39.494, range=0..100),
    X2=Slider(20.961, range=0..100),
    X3=Slider(0, range=0..1),
    X4=Slider(0, range=0..1),
    X5=Slider(57.997, range=0..100),
    X6=neg)  # -> out, Y, Status; inputs ModelPath: String, Reload: Boolean, X1: Double, X2: Double, X3: Double, X4: Double, X5: Double, X6: Double
# ---------- c_script: C# ----------
#r "C:\Users\shiyi\OneDrive\Documents\0-Academic acativities\DF2026\Preparation\04_Model_Packaging_Demo\DF2026_Plugin_Template\Plugin\bin\Release\net7.0-windows\win-x64\Microsoft.ML.OnnxRuntime.dll"
using System;
using System.Collections.Generic;
using System.IO;
using System.Runtime.InteropServices;

using Rhino;
using Rhino.Geometry;

using Grasshopper;using Grasshopper.Kernel;
using Grasshopper.Kernel.Data;
using Grasshopper.Kernel.Types;

using Microsoft.ML.OnnxRuntime;
using Microsoft.ML.OnnxRuntime.Tensors;

public class Script_Instance : GH_ScriptInstance
{
    private static InferenceSession _session = null;
    private static string _loadedModelPath = null;

    [DllImport("kernel32.dll", SetLastError = true, CharSet = CharSet.Unicode)]
    private static extern bool SetDllDirectory(string lpPathName);

    private void RunScript(
		string ModelPath,
		bool Reload,
		double X1,
		double X2,
		double X3,
		double X4,
		double X5,
		double X6,
		ref object Y,
		ref object Status)
    {
        Y = null;
        Status = "";

        try
        {
            if (string.IsNullOrWhiteSpace(ModelPath))
            {
                Status = Status = "Please connect a valid ONNX model path to ModelPath.";
                return;
            }

            if (!File.Exists(ModelPath))
            {
                Status = "ONNX model file not found:\n" + ModelPath;
                return;
            }

            // This helps Rhino find native onnxruntime.dll.
            // Put onnxruntime.dll in the same folder as Microsoft.ML.OnnxRuntime.dll.
            string onnxRuntimeManagedDllPath = typeof(InferenceSession).Assembly.Location;
            string onnxRuntimeFolder = Path.GetDirectoryName(onnxRuntimeManagedDllPath);

            if (!string.IsNullOrWhiteSpace(onnxRuntimeFolder))
            {
                SetDllDirectory(onnxRuntimeFolder);
            }

            if (_session == null || Reload || _loadedModelPath != ModelPath)
            {
                if (_session != null)
                {
                    _session.Dispose();
                    _session = null;
                }

                _session = new InferenceSession(ModelPath);
                _loadedModelPath = ModelPath;
            }

            string inputName = "float_input";

            if (!_session.InputMetadata.ContainsKey(inputName))
            {
                foreach (string key in _session.InputMetadata.Keys)
                {
                    inputName = key;
                    break;
                }
            }

            DenseTensor<float> inputTensor = new DenseTensor<float>(new int[] { 1, 6 });

            inputTensor[0, 0] = (float)X1;
            inputTensor[0, 1] = (float)X2;
            inputTensor[0, 2] = (float)X3;
            inputTensor[0, 3] = (float)X4;
            inputTensor[0, 4] = (float)X5;
            inputTensor[0, 5] = (float)X6;

            List<NamedOnnxValue> inputs = new List<NamedOnnxValue>();
            inputs.Add(NamedOnnxValue.CreateFromTensor<float>(inputName, inputTensor));

            IDisposableReadOnlyCollection<DisposableNamedOnnxValue> results = null;

            try
            {
                results = _session.Run(inputs);

                bool hasPrediction = false;
                double prediction = 0.0;

                foreach (DisposableNamedOnnxValue result in results)
                {
                    Tensor<float> outputTensor = result.AsTensor<float>();

                    foreach (float value in outputTensor)
                    {
                        prediction = (double)value;
                        hasPrediction = true;
                        break;
                    }

                    break;
                }

                if (!hasPrediction)
                {
                    Status = "The model returned no prediction.";
                    return;
                }

                Y = prediction;

                Status =
                    "Prediction successful.\n" +
                    "Model path:\n" + ModelPath + "\n\n" +
                    "ONNX Runtime managed DLL:\n" + onnxRuntimeManagedDllPath + "\n\n" +
                    "Input name: " + inputName + "\n" +
                    "Feature order: X1, X2, X3, X4, X5, X6";
            }
            finally
            {
                if (results != null)
                {
                    results.Dispose();
                }
            }
        }
        catch (Exception ex)
        {
            Status =
                "Prediction failed:\n" +
                ex.Message + "\n\n" +
                "If the error says onnxruntime.dll cannot be found, copy onnxruntime.dll into the same folder as Microsoft.ML.OnnxRuntime.dll.";
        }
    }
}
# ---------- end c_script ----------
panel = Panel(c_script.out)
panel_2 = Panel(c_script.Status)
panel_3 = Panel(c_script.Y)
